# Grasshopper definition gls.gh (Grasshopper 1.0.7)

p10 = Point(<point referenced from the Rhino model>)
p15 = Point(<point referenced from the Rhino model>)
p18 = Point(<point referenced from the Rhino model>)
p73 = Point(<point referenced from the Rhino model>)
p25 = Point(<point referenced from the Rhino model>)
p29 = Point(<point referenced from the Rhino model>)
p14 = Point(<point referenced from the Rhino model>)
p36 = Point(<point referenced from the Rhino model>)
p64 = Point(<point referenced from the Rhino model>)
p43 = Point(<point referenced from the Rhino model>)
p78 = Point(<point referenced from the Rhino model>)
Z = UnitZ(Factor=Slider(6, range=0..10))
Z_2 = UnitZ(Factor=Slider(5, range=0..10))
bzspan = BezierSpan(StartPoint=p10, StartTangent=Z, EndPoint=p18, EndTangent=Z)  # -> Curve, Length, Domain
bzspan_2 = BezierSpan(StartPoint=p10, StartTangent=Z, EndPoint=p73, EndTangent=Z)  # -> Curve, Length, Domain
bzspan_3 = BezierSpan(StartPoint=p10, StartTangent=Z, EndPoint=p15, EndTangent=Z)  # -> Curve, Length, Domain
bzspan_4 = BezierSpan(StartPoint=p10, StartTangent=Z, EndPoint=p25, EndTangent=Z)  # -> Curve, Length, Domain
bzspan_5 = BezierSpan(StartPoint=p10, StartTangent=Z, EndPoint=p14, EndTangent=Z)  # -> Curve, Length, Domain
bzspan_6 = BezierSpan(StartPoint=p10, StartTangent=Z, EndPoint=p29, EndTangent=Z)  # -> Curve, Length, Domain
bzspan_7 = BezierSpan(StartPoint=p78, StartTangent=Z_2, EndPoint=p36, EndTangent=Z_2)  # -> Curve, Length, Domain
bzspan_8 = BezierSpan(StartPoint=p29, StartTangent=Z_2, EndPoint=p36, EndTangent=Z_2)  # -> Curve, Length, Domain
bzspan_9 = BezierSpan(StartPoint=p29, StartTangent=Z_2, EndPoint=p64, EndTangent=Z_2)  # -> Curve, Length, Domain
bzspan_10 = BezierSpan(StartPoint=p29, StartTangent=Z_2, EndPoint=p43, EndTangent=Z_2)  # -> Curve, Length, Domain
